# Grasshopper definition SynapseExample.gh (Grasshopper 1.0.7)
# plug-ins: Synapse

# ---- group: ficticious data
genes = GenePool(Decimals=0, Maximum=99, Minimum=1, Value=[35.98291824, 41, 36, 72])
genes_2 = GenePool(Decimals=0, Maximum=99, Minimum=1, Value=[75, 40, 74, 74])
color3 = Slider(0.81, range=0.01..1)
color0 = Slider(0.11, range=0.01..1)
color1 = Slider(0.56, range=0.01..1)
color2 = Slider(0.43, range=0.01..1)
genes_3 = GenePool(Decimals=0, Maximum=99, Minimum=1, Value=[19, 19, 21, 31])
genes_4 = GenePool(Decimals=0, Maximum=99, Minimum=1, Value=[31, 16, 32, 20])
gradient = Gradient(
    LowerLimit="0",
    UpperLimit="1",
    Parameter=[color0, color1, color2, color3],
    stops=[0: RGB(243, 57, 0), 0.1: RGB(236, 27, 60), 0.2: RGB(210, 0, 118), 0.3: RGB(103, 0, 120), 0.4: RGB(39, 72, 161), 0.5: RGB(1, 192, 229), 0.6: RGB(18, 178, 90), 0.7: RGB(79, 186, 8), 0.8: RGB(220, 237, 32), 0.9: RGB(247, 159, 20), 1: RGB(243, 57, 0)])
merge = Merge(Data1=graft(genes_3), Data2=graft(genes), Data3=graft(genes_2), Data4=graft(genes_4))
item = ListItem(List=gradient, Index=0, Wrap=True)  # -> Item, Item1, Item2, Item3
flip = FlipMatrix(Data=merge)  # -> simplify(Data)
series = Series(Start=0, Step=1, Count="4")
merge_2 = Merge(
    Data1=Slider(23, range=1..99),
    Data2=Slider(40, range=1..99),
    Data3=Slider(12, range=1..99),
    Data4=Slider(60, range=1..99))
merge_3 = Merge(Data1=item.Item, Data2=item.Item1, Data3=item.Item2, Data4=item.Item3)
complex = CreateComplex(Real=Slider(117, range=50..200), Imaginary=Slider(99, range=50..200))

# ---- group: stack properties of certain tabs
number_slider = Slider(260, range=100..800)
D = Slider(10, range=5..20)
D_2 = Slider(5, range=5..20)
int = Integer(D_2)
int_2 = Integer(D)
size = SynapseSize(Width=number_slider, Height=Slider(225, range=100..800))

# ----
ssize = SnpSize(Width="40", Height="26")
stoggle = SnpToggle(Property=flatten("Size"), PropertyValue=flatten(ssize))  # -> AllProperties, Control
slabel = SnpTextLabel(Property=flatten("Text"), PropertyValue=flatten("Show table"))  # -> AllProperties, Control
panel = Panel("""DecimalPlaces
Increment""")
panel_2 = Panel("""sliderwidth
maxvalue
minvalue
steps""")
svalq = SnpValueQuery(SynapseObject=stoggle.Control, Update=True)
argb = SplitARGB(Colour=ColourSwatch(SwatchColor=RGB(50, 132, 209)), IntegerChannels=True)  # -> Alpha, Red, Green, Blue
X = Slider(11, range=1..50, expression="x*10")
sfont = SynapseFont(FontFamily="Lucida Console", FontSize=8.25, FontStyle=0, Decoration=0)
size_2 = SynapseSize(Width=number_slider, Height=Slider(122, range=100..800))
G = Slider(10, range=1..50)
A = Slider(1, range=0..3)
panel_3 = Panel("""2
2""")
panel_4 = Panel("""Orientation
Width
Spacing
VerticalContentAlignment""")
sicon = SnpIcon(FileLocation="input image filepath")  # disabled
scolor = SynapseColor(Alpha=argb.Alpha, Red=argb.Red, Green=argb.Green, Blue=argb.Blue)
panel_5 = Panel("""115
20
5
5""")
int_3 = Integer(panel_3)
sbtn = SnpButton(Property=flatten("Image"), PropertyValue=flatten(sicon), trueonly=True)  # -> AllProperties, Control; disabled
snud = SynapseNumUpDn(Property=flatten(panel), PropertyValue=flatten(int_3))  # -> AllProperties, Control
ss = SynapseSlider(Property=flatten(panel_2), PropertyValue=flatten(panel_5), Coefficient=0.1)  # -> AllProperties, Control
sbtn_2 = SnpButton(Property=flatten("Font"), PropertyValue=flatten(sfont), trueonly=True)  # -> AllProperties, Control
scb = SynapseCheckBox(Property=flatten("TextColor"), PropertyValue=flatten(ColourSwatch(SwatchColor=RGB(178, 43, 154))))  # -> AllProperties, Control
slbl = SynapseLabel(Property=flatten("text"), PropertyValue=flatten("object name"))  # -> AllProperties, Control
stb = SynapseTextBox(Property=flatten("TextColor"), PropertyValue=flatten(scolor), live=False)  # -> AllProperties, Control
H = Slider(45, range=30..60)
sdm = SynapseDropMenu(Options=flatten(["Alpha", "Beta", "Omega"]))  # -> AllProperties, Control
int_4 = Integer([X, G, A])
list = ValueList({"bullet", "box", "pointer", "arrow", "heart", "diamond", "circle", "pyramid"}, selected="pyramid")
strends = SynapseTrends(Size=complex, Numbers=flip, Name=graft(series), Color=graft(merge_3))  # -> ChartObject, ChartData
shrrchy = SynapseHierarchy(Size=complex, Numbers=merge_2, Colors=merge_3)  # -> ChartObject, ChartData
scombo = SynapseComboBox(Options=flatten(["Alpha", "Beta", "Omega"]))  # -> AllProperties, Control
X_2 = Slider(11, range=1..50, expression="x*10")
stb_2 = SynapseTextBox(Mask="(000) 000 0000")  # -> AllProperties, Control, AllMasks
X_3 = Slider(25, range=1..50, expression="x*10")
sstack = SnpStack(
    Property=flatten(panel_4),
    PropertyValue=flatten(["horizontal", int_4]),
    Controls=flatten([slabel.Control, stoggle.Control]))  # -> AllProperties, Control
# some properties won't convert
# data type automatically
# manually enforce the integer type
D_3 = Slider(10, range=5..20)
panel_6 = Panel("""Some option A
A better option B
Another option C
Last option D""")
int_5 = Integer(H)
text = Options(flatten(["Alpha", "Beta", "Omega"]))

# ---- group: ficticious data
random = Random(Range="999", Number="7", Seed=2, Integers=True)
lng = ListLength(List=text)
random_2 = Random(Range="999", Number=lng, Seed=random, Integers=True)  # -> simplify(Random)
entwine = Entwine(Branch0X=text, Branch1X=random_2, FlattenInputs=False)
path_mapper = PathMapper(entwine, source="{A;B}", target="{path_index}")

# ----
panel_7 = Panel("""Size
Spacing""")
merge_4 = Merge(
    Data1=flatten(scb.Control),
    Data2=flatten(sbtn_2.Control),
    Data3=flatten(slbl.Control),
    Data4=flatten(snud.Control),
    Data5=flatten(ss.Control),
    Data6=flatten(stb.Control),
    Data7=flatten(sbtn.Control))
srange = SnpRangeSlider(Domain=Domain(0, 20), Property=flatten("Height"), PropertyValue=flatten(int_5))  # -> AllProperties, Control
legend = SynapseLegend(Property=flatten("Marker"), PropertyValue=flatten(list), Data=shrrchy.ChartData)  # -> AllProperties, Legend
legend_2 = SynapseLegend(Property=flatten("Marker"), PropertyValue=flatten(list), Data=strends.ChartData)  # -> AllProperties, Legend
panel_8 = Panel("""Text|.txt
3D Files|.3dm,.obj,.skp
2D Files|.pdf,.dwg""")
int_6 = Integer(X_2)
int_7 = Integer(X_3)
int_8 = Integer(D_3)
sstack_2 = SynapseStack(
    Property=flatten(panel_7),
    PropertyValue=flatten([size, int]),
    Controls=flatten([scombo.Control, sdm.Control, stb_2.Control, sstack.Control]))  # -> AllProperties, Control
panel_9 = Panel("""padding
spacing
Width
Height""")
pickone = SynapseSingleSelect(Options=flatten(panel_6))  # -> AllProperties, Control
merge_5 = Merge(Data1=flatten(int_8), Data2=flatten(int_8), Data3=flatten(int_7), Data4=flatten(int_6))
panel_10 = Panel("""Orientation
Size
Spacing""")
chart_legend = Data([shrrchy.ChartObject, legend.Legend])
list_2 = ValueList({"graph 0": 0, "graph 1": 1}, selected="graph 0")
chart_legen = Data([strends.ChartObject, legend_2.Legend])
stxy = SynapseTableXY(Controls=merge_4, Rows=Slider(3, range=1..4))  # -> Coordinates, Dimensions
merge_6 = Merge(Data1=flatten("horizontal"), Data2=flatten(size_2), Data3=flatten(int))
slb = SynapseListBox(Options=flatten(text))  # -> AllProperties, Control
int_9 = Integer("200")
stable = SnpTableLayout(
    Property=flatten(panel_9),
    PropertyValue=flatten(merge_5),
    Controls=flatten(merge_4),
    ControlLocation=flatten(stxy.Coordinates),
    TableDimension=stxy.Dimensions,
    stretchy=False)  # -> AllProperties, Control
sfile = SnpFilePicker(Property=flatten("Filters"), PropertyValue=flatten(panel_8))  # -> AllProperties, Control
panel_11 = Panel("""Padding
Width""")
sbtn_3 = SnpButton(Property=flatten("Text"), PropertyValue=flatten("Say what"), trueonly=False)  # -> AllProperties, Control
smt = SynapseMultiTexts(Property=flatten("Width"), PropertyValue=flatten(int_9))  # -> AllProperties, Control
panel_12 = Panel("""Size
Padding
Spacing""")
filter = StreamFilter(Gate=list_2, Stream0=chart_legend, Stream1=chart_legen)
int_10 = Integer(["10", number_slider])
sxpdr = SnpExpander(
    Property=flatten("Expanded"),
    PropertyValue=flatten(Toggle(True)),
    Controls=flatten([srange.Control, pickone.Control]),
    stretchy=False)  # -> AllProperties, Control
sstack_3 = SynapseStack(Property=flatten(panel_10), PropertyValue=flatten(merge_6), Controls=flatten([slb.Control, sstack_2.Control]))  # -> AllProperties, Control
size_3 = SynapseSize(Width=number_slider, Height=Slider(294, range=100..800))
sgv = SnpGridView(Data=path_mapper)  # -> AllProperties, Control
bool = Boolean(svalq)
svalq_2 = SnpValueQuery(SynapseObject=sbtn_3.Control, Update=True)
merge_7 = Merge(Data1=flatten(size_3), Data2=flatten(int_8), Data3=flatten(int))
sdylo = SnpDynaLayout(Controls=flatten([stable.Control, sfile.Control]), stretchy=False)  # -> AllProperties, Control
sstack_4 = SynapseStack(Property=flatten(panel_12), PropertyValue=flatten([size, int_2, int]), Controls=flatten([smt.Control, sxpdr.Control]))  # -> AllProperties, Control
sdylo_2 = SnpDynaLayout(Property=flatten(panel_11), PropertyValue=flatten(int_10), Controls=flatten([filter, sbtn_3.Control]), stretchy=False)  # -> AllProperties, Control
ssetval = SnpOverride(Property="Visible", Value=bool, Control=sgv.Control)
spop = SnpPopUp(Show=svalq_2, Message="I don't know. Do you know?", Urgency=3)
sstack_5 = SynapseStack(Property=flatten(panel_12), PropertyValue=flatten(merge_7), Controls=flatten([sstack_3.Control, sgv.Control]))  # -> AllProperties, Control
Y = Slider(29, range=1..50, expression="x*10")
X_4 = Slider(30, range=1..50, expression="x*10")
padding = Slider(5, range=1..15)
merge_8 = Merge(
    Data1=flatten(sdylo.Control),
    Data2=flatten(sstack_4.Control),
    Data3=flatten(sstack_5.Control),
    Data4=flatten(sdylo_2.Control))
vec = VectorXYZ(XComponent=X_4, YComponent=Y, ZComponent=0)  # -> Vector, Length
list_3 = ValueList({"1st": 0, "2nd": 1, "3rd": 2, "4th": 3}, selected="3rd")
resizable = BooleanToggle(False)
panel_13 = Panel("""Alpha
Beta
Gamma
Delta""")
topmost = BooleanToggle(False)
pypt = GhPythonScript(x=Slider(1, range=1..50, expression="x*10"), y=Slider(4, range=1..50, expression="x*10"))  # -> out, p; inputs x: Int32, y: Int32
# ---------- pypt: Python ----------
"""creating an Eto.Drawing.Point object for Synapse plugin to consume.
    Inputs:
        x: x coordinate
        y: y coordinate
    Output:
        p: point object"""

__author__ = "wwang"
__version__ = "2021.02.19"

import Eto.Drawing as drw

p = drw.Point(x,y)
# ---------- end pypt ----------
int_11 = Integer(padding)
int_12 = Integer(list_3)
panel_14 = Panel("""color
title
Location
size
Topmost
Padding
Resizable""")
merge_9 = Merge(
    Data1=flatten(scolor),
    Data2=flatten("NimbleDashboard"),
    Data3=flatten(pypt.p),
    Data4=flatten(vec.Vector),
    Data5=flatten(topmost),
    Data6=flatten(int_11),
    Data7=flatten(resizable))
stabs = SnpTabbedView(
    Property=flatten("SelectedIndex"),
    PropertyValue=flatten(int_12),
    Controls=flatten(merge_8),
    TabName=flatten(panel_13),
    stretchy=False)  # -> AllProperties, Control
sendtorhpanel = BooleanToggle(False)
showwindow = BooleanToggle(False)
svalq_3 = SnpValueQuery(SynapseObject=stabs.Control, Update=True)
swindow = SynapseWindow(
    Show=showwindow,
    Property=flatten(panel_14),
    PropertyValue=flatten(merge_9),
    Contents=flatten(stabs.Control),
    ctrlfill=True,
    ctrlredo=True,
    ghowned=True,
    uitheme=True)  # -> AllProperties, Window
panel_15 = Panel(svalq_3)
# This will not run if
# Synapse.rhp isn't installed
rcp = RemotePanel(Send=sendtorhpanel, Window=swindow.Window)
