# Grasshopper definition SynapseExample042.gh (Grasshopper 1.0.7)
# plug-ins: Synapse

genes = GenePool(Decimals=0, Maximum=99, Minimum=1, Value=[35.98291824, 41, 36, 72])
genes_2 = GenePool(Decimals=0, Maximum=99, Minimum=1, Value=[75, 40, 74, 74])
color3 = Slider(0.81, range=0.01..1)
color0 = Slider(0.11, range=0.01..1)
color1 = Slider(0.56, range=0.01..1)
color2 = Slider(0.43, range=0.01..1)
genes_3 = GenePool(Decimals=0, Maximum=99, Minimum=1, Value=[19, 19, 21, 31])
genes_4 = GenePool(Decimals=0, Maximum=99, Minimum=1, Value=[31, 16, 32, 20])

# ---- group: stack properties of certain tabs
number_slider = Slider(260, range=100..800)
D = Slider(10, range=5..20)
D_2 = Slider(5, range=5..20)
int = Integer(D_2)
int_2 = Integer(D)
size = SynapseSize(Width=number_slider, Height=Slider(225, range=100..800))

# ----
gradient = Gradient(
    LowerLimit="0",
    UpperLimit="1",
    Parameter=[color0, color1, color2, color3],
    stops=[0: RGB(243, 57, 0), 0.1: RGB(236, 27, 60), 0.2: RGB(210, 0, 118), 0.3: RGB(103, 0, 120), 0.4: RGB(39, 72, 161), 0.5: RGB(1, 192, 229), 0.6: RGB(18, 178, 90), 0.7: RGB(79, 186, 8), 0.8: RGB(220, 237, 32), 0.9: RGB(247, 159, 20), 1: RGB(243, 57, 0)])
merge = Merge(Data1=graft(genes_3), Data2=graft(genes), Data3=graft(genes_2), Data4=graft(genes_4))
item = ListItem(List=gradient, Index=0, Wrap=True)  # -> Item, Item1, Item2, Item3
flip = FlipMatrix(Data=merge)  # -> simplify(Data)
panel = Panel("""DecimalPlaces
Increment""")
panel_2 = Panel("""sliderwidth
maxvalue
minvalue
steps""")
series = Series(Start=0, Step=1, Count="4")
merge_2 = Merge(
    Data1=Slider(23, range=1..99),
    Data2=Slider(40, range=1..99),
    Data3=Slider(12, range=1..99),
    Data4=Slider(60, range=1..99))
merge_3 = Merge(Data1=item.Item, Data2=item.Item1, Data3=item.Item2, Data4=item.Item3)
complex = CreateComplex(Real=Slider(117, range=50..200), Imaginary=Slider(99, range=50..200))
argb = SplitARGB(Colour=ColourSwatch(SwatchColor=RGB(50, 132, 209)), IntegerChannels=True)  # -> Alpha, Red, Green, Blue
sfont = SynapseFont(FontFamily="Lucida Console", FontSize=8.25, FontStyle=0, Decoration=0)
size_2 = SynapseSize(Width=number_slider, Height=Slider(122, range=100..800))
panel_3 = Panel("""2
2""")
sicon = SnpIcon(FileLocation="input image filepath")  # disabled
scolor = SynapseColor(Alpha=argb.Alpha, Red=argb.Red, Green=argb.Green, Blue=argb.Blue)
panel_4 = Panel("""115
20
5
5""")
int_3 = Integer(panel_3)
sbtn = SnpButton(Property=flatten("Image"), PropertyValue=flatten(sicon), trueonly=True)  # -> AllProperties, Control; disabled
snud = SynapseNumUpDn(Property=flatten(panel), PropertyValue=flatten(int_3))  # -> AllProperties, Control
ss = SynapseSlider(Property=flatten(panel_2), PropertyValue=flatten(panel_4), Coefficient=0.1)  # -> AllProperties, Control
sbtn_2 = SnpButton(Property=flatten("Font"), PropertyValue=flatten(sfont), trueonly=True)  # -> AllProperties, Control
scb = SynapseCheckBox(Property=flatten("TextColor"), PropertyValue=flatten(ColourSwatch(SwatchColor=RGB(178, 43, 154))))  # -> AllProperties, Control
slbl = SynapseLabel(Property=flatten("text"), PropertyValue=flatten("object name"))  # -> AllProperties, Control
stb = SynapseTextBox(Property=flatten("TextColor"), PropertyValue=flatten(scolor), live=False)  # -> AllProperties, Control
H = Slider(45, range=30..60)
sdm = SynapseDropMenu(Options=flatten(["Alpha", "Beta", "Omega"]))  # -> AllProperties, Control
ssize = SnpSize(Width="40", Height="26")
list = ValueList({"bullet", "box", "pointer", "arrow", "heart", "diamond", "circle", "pyramid"}, selected="pyramid")
strends = SynapseTrends(Size=complex, Numbers=flip, Name=graft(series), Color=graft(merge_3))  # -> ChartObject, ChartData
random = Random(Range="999", Number="7", Seed=2, Integers=True)
shrrchy = SynapseHierarchy(Size=complex, Numbers=merge_2, Colors=merge_3)  # -> ChartObject, ChartData
scombo = SynapseComboBox(Options=flatten(["Alpha", "Beta", "Omega"]))  # -> AllProperties, Control
X = Slider(11, range=1..50, expression="x*10")
stb_2 = SynapseTextBox(Mask="(000) 000 0000")  # -> AllProperties, Control, AllMasks
X_2 = Slider(25, range=1..50, expression="x*10")
stoggle = SnpToggle(Property=flatten("Size"), PropertyValue=flatten(ssize))  # -> AllProperties, Control
# some properties won't convert
# data type automatically
# manually enforce the integer type
D_3 = Slider(10, range=5..20)
panel_5 = Panel("""Some option A
A better option B
Another option C
Last option D""")
int_4 = Integer(H)
text = Options(flatten(["Alpha", "Beta", "Omega"]))
lng = ListLength(List=text)
random_2 = Random(Range="999", Number=lng, Seed=random, Integers=True)  # -> simplify(Random)
panel_6 = Panel("""Size
Spacing""")
merge_4 = Merge(
    Data1=flatten(scb.Control),
    Data2=flatten(sbtn_2.Control),
    Data3=flatten(slbl.Control),
    Data4=flatten(snud.Control),
    Data5=flatten(ss.Control),
    Data6=flatten(stb.Control),
    Data7=flatten(sbtn.Control))
srange = SnpRangeSlider(Domain=Domain(0, 20), Property=flatten("Height"), PropertyValue=flatten(int_4))  # -> AllProperties, Control
legend = SynapseLegend(Property=flatten("Marker"), PropertyValue=flatten(list), Data=shrrchy.ChartData)  # -> AllProperties, Legend
svalq = SnpValueQuery(SynapseObject=stoggle.Control, Update=True)
legend_2 = SynapseLegend(Property=flatten("Marker"), PropertyValue=flatten(list), Data=strends.ChartData)  # -> AllProperties, Legend
panel_7 = Panel("""Text|.txt
3D Files|.3dm,.obj,.skp
2D Files|.pdf,.dwg""")
int_5 = Integer(X)
int_6 = Integer(X_2)
int_7 = Integer(D_3)
entwine = Entwine(Branch0X=text, Branch1X=random_2, FlattenInputs=False)
sstack = SynapseStack(
    Property=flatten(panel_6),
    PropertyValue=flatten([size, int]),
    Controls=flatten([scombo.Control, sdm.Control, stb_2.Control, stoggle.Control]))  # -> AllProperties, Control
panel_8 = Panel("""padding
spacing
Width
Height""")
pickone = SynapseSingleSelect(Options=flatten(panel_5))  # -> AllProperties, Control
merge_5 = Merge(Data1=flatten(int_7), Data2=flatten(int_7), Data3=flatten(int_6), Data4=flatten(int_5))
panel_9 = Panel("""Orientation
Size
Spacing""")
chart_legend = Data([shrrchy.ChartObject, legend.Legend])
list_2 = ValueList({"graph 0": 0, "graph 1": 1}, selected="graph 0")
chart_legen = Data([strends.ChartObject, legend_2.Legend])
stxy = SynapseTableXY(Controls=merge_4, Rows=Slider(3, range=1..4))  # -> Coordinates, Dimensions
merge_6 = Merge(Data1=flatten("horizontal"), Data2=flatten(size_2), Data3=flatten(int))
slb = SynapseListBox(Options=flatten(text))  # -> AllProperties, Control
path_mapper = PathMapper(entwine, source="{A;B}", target="{path_index}")
int_8 = Integer("200")
int_9 = Integer(["10", number_slider])
stable = SnpTableLayout(
    Property=flatten(panel_8),
    PropertyValue=flatten(merge_5),
    Controls=flatten(merge_4),
    ControlLocation=flatten(stxy.Coordinates),
    TableDimension=stxy.Dimensions,
    stretchy=False)  # -> AllProperties, Control
sfile = SnpFilePicker(Property=flatten("Filters"), PropertyValue=flatten(panel_7))  # -> AllProperties, Control
panel_10 = Panel("""Padding
Width""")
smt = SynapseMultiTexts(Property=flatten("Width"), PropertyValue=flatten(int_8))  # -> AllProperties, Control
panel_11 = Panel("""Size
Padding
Spacing""")
filter = StreamFilter(Gate=list_2, Stream0=chart_legend, Stream1=chart_legen)
sgv = SnpGridView(Data=path_mapper)  # -> AllProperties, Control
sxpdr = SnpExpander(
    Property=flatten("Expanded"),
    PropertyValue=flatten(Toggle(True)),
    Controls=flatten([srange.Control, pickone.Control]),
    stretchy=False)  # -> AllProperties, Control
sstack_2 = SynapseStack(Property=flatten(panel_9), PropertyValue=flatten(merge_6), Controls=flatten([slb.Control, sstack.Control]))  # -> AllProperties, Control
size_3 = SynapseSize(Width=number_slider, Height=Slider(294, range=100..800))
bool = Boolean(svalq)
sdylo = SnpDynaLayout(Property=flatten(panel_10), PropertyValue=flatten(int_9), Controls=flatten(filter), stretchy=False)  # -> AllProperties, Control
merge_7 = Merge(Data1=flatten(size_3), Data2=flatten(int_7), Data3=flatten(int))
ssetval = SnpOverride(Property="Visible", Value=bool, Control=sgv.Control)
sdylo_2 = SnpDynaLayout(Controls=flatten([stable.Control, sfile.Control]), stretchy=False)  # -> AllProperties, Control
sstack_3 = SynapseStack(Property=flatten(panel_11), PropertyValue=flatten([size, int_2, int]), Controls=flatten([smt.Control, sxpdr.Control]))  # -> AllProperties, Control
sstack_4 = SynapseStack(Property=flatten(panel_11), PropertyValue=flatten(merge_7), Controls=flatten([sstack_2.Control, sgv.Control]))  # -> AllProperties, Control
Y = Slider(29, range=1..50, expression="x*10")
X_3 = Slider(30, range=1..50, expression="x*10")
padding = Slider(5, range=1..15)
merge_8 = Merge(
    Data1=flatten(sdylo_2.Control),
    Data2=flatten(sstack_3.Control),
    Data3=flatten(sstack_4.Control),
    Data4=flatten(sdylo.Control))
vec = VectorXYZ(XComponent=X_3, YComponent=Y, ZComponent=0)  # -> Vector, Length
list_3 = ValueList({"1st": 0, "2nd": 1, "3rd": 2, "4th": 3}, selected="3rd")
resizable = BooleanToggle(False)
panel_12 = Panel("""Alpha
Beta
Gamma
Delta""")
topmost = BooleanToggle(False)
pypt = GhPythonScript(x=Slider(1, range=1..50, expression="x*10"), y=Slider(4, range=1..50, expression="x*10"))  # -> out, p; inputs x: Int32, y: Int32
# ---------- pypt: Python ----------
"""creating an Eto.Drawing.Point object for Synapse plugin to consume.
    Inputs:
        x: x coordinate
        y: y coordinate
    Output:
        p: point object"""

__author__ = "wwang"
__version__ = "2021.02.19"

import Eto.Drawing as drw

p = drw.Point(x,y)
# ---------- end pypt ----------
int_10 = Integer(padding)
int_11 = Integer(list_3)
panel_13 = Panel("""color
title
Location
size
Topmost
Padding
Resizable""")
merge_9 = Merge(
    Data1=flatten(scolor),
    Data2=flatten("NimbleDashboard"),
    Data3=flatten(pypt.p),
    Data4=flatten(vec.Vector),
    Data5=flatten(topmost),
    Data6=flatten(int_10),
    Data7=flatten(resizable))
stabs = SnpTabbedView(
    Property=flatten("SelectedIndex"),
    PropertyValue=flatten(int_11),
    Controls=flatten(merge_8),
    TabName=flatten(panel_12),
    stretchy=False)  # -> AllProperties, Control
sendtorhpanel = BooleanToggle(False)
showwindow = BooleanToggle(False)
svalq_2 = SnpValueQuery(SynapseObject=stabs.Control, Update=True)
swindow = SynapseWindow(
    Show=showwindow,
    Property=flatten(panel_13),
    PropertyValue=flatten(merge_9),
    Contents=flatten(stabs.Control),
    ctrlfill=True,
    ctrlredo=True,
    ghowned=True,
    uitheme=True)  # -> AllProperties, Window
panel_14 = Panel(svalq_2)
# This will not run if
# Synapse.rhp isn't installed
rcp = RemotePanel(Send=sendtorhpanel, Window=swindow.Window)
