# Grasshopper definition SynapseWebViewSandbox.gh (Grasshopper 1.0.7)
# plug-ins: Synapse

F = File("D:\Github repos\GH_Eto\SynapseWebView.html")
panel = Panel("""num_param
btn_param
tf_param
tb_param""")
file = ReadFile(File=F, PerLineParse=False)  # disabled
ssize = SnpSize(Width=Slider(5, range=2..10, expression="x*100"), Height=Slider(3, range=2..10, expression="x*100"))
swebctrls = SnpWebCtrls(HTML=file, ElementIDs=flatten(panel))  # -> AllProperties, WebForm
sdomsl = SnpDomSlider()  # -> AllProperties, Control
py_wv = GhPythonScript(x=Toggle(False), S=ssize, H=file)  # -> a; disabled
# ---------- py_wv: Python ----------
__author__ = "Will Wang"
__version__ = "2022.01.31"

from ghpythonlib.componentbase import executingcomponent as component
import Grasshopper, GhPython
import System
import Rhino
import Eto.Forms as eforms
import Eto.Drawing as edrw
import Rhino.RhinoApp as rhapp

class WVSandbox(component):
    def __init__(self):
        super(WVSandbox, self).__init__()
        self.win = None
        self.txtout = ''
        self.btnpress = False
    
    def RunScript(self, x, S, H):
        if x:
            if not self.win:
                self.NewWin(S, H)
            elif not self.win.Visible:
                self.win.Show()
        else:
            self.NewWin(S, H)

        return self.txtout

    def NewWin(self, size, html):
        self.win = eforms.Form()
        self.wv = eforms.WebView()
        self.wv.Size = size
        self.layout = eforms.DynamicLayout()
        self.layout.AddSeparateRow(self.wv, None)
        self.layout.AddSeparateRow(None)
        self.win.Content =self.layout
        
        
        self.wv.LoadHtml(html)
        
        self.wv.DocumentLoading += self.OnRefresh

    def OnRefresh(self, s, e):
        try:
            if e.Uri.Scheme == 'synapse':
                if e.Uri.LocalPath == 'num_param':
                    self.txtout = str(self.wv.ExecuteScript(
                        """
                        var e = document.getElementById('num_param');
                        try{ return e.value;}
                        catch (er) {return 'ERROR getting element by id';}
                        """
                        )
                    )
                elif e.Uri.LocalPath == 'tf_param':
                    self.txtout = str(self.wv.ExecuteScript(
                        'return document.getElementById("tf_param").checked;'
                        )
                    )
                elif e.Uri.LocalPath == 'btn_param':
                    if e.Uri.Query == '?press':
                        self.btnpress = True
                    elif e.Uri.Query =='?lift':
                        self.btnpress = False
                    self.txtout = str(self.btnpress)

                e.Cancel = True
                self.ExpireSolution(True) # expire in event handler is ok!
        except Exception as ex:
            eforms.MessageBox.Show(str(ex))
# ---------- end py_wv ----------
sdylo = SnpDynaLayout(Controls=flatten([sdomsl.Control, swebctrls.WebForm]))  # -> AllProperties, Control
svalq = SnpValueQuery(SynapseObject=[sdomsl.Control, swebctrls.WebForm], Update=True)
panel_2 = Panel(py_wv)
panel_3 = Panel(svalq)
swin = SnpWindow(Show=Toggle(False), Contents=flatten(sdylo.Control), ctrlfill=False, ctrlredo=False, ghowned=False)  # -> AllProperties, Window
